# Dynamo graph EnergyAnalysisForDynamo_ex1b_CreateEnergyModelAndSetSurfaceParams.dyn (Dynamo 0.7.4.3245)

# note: 1. Select Mass element from Revit/Vasari document
select_model_element = DSModelElementSelection()  # 1 picked in the model
levels = Levels("Level 1")
# note: 2. Create Analysis Zones From Mass and Levels
createByMassLevels = EnergyAnalysisForDynamo.PrepareEnergyModel.CreateByMassLevels(select_model_element, levels)
surface_index = IntegerSlider(3, range=0..10)
getItemAtIndex = List.GetItemAtIndex(createByMassLevels.out2, surface_index)
# note: 3. Highlight the modified surface
drawAnalysisSurface = EnergyAnalysisForDynamo.PrepareEnergyModel.DrawAnalysisSurface(getItemAtIndex)
glazing = DoubleSlider(0.6, range=0.2..0.8)
shading_depth = DoubleSlider(1, range=0..1.5)
sill_height = DoubleSlider(1, range=0..2)
conceptual_construction_types = ConcConstTypeDropdown("HighMassConstructionHighInsulation")  # "Conceptual Construction Types Dropdown"
# note: 4. Customize parameters for the surface of interest
setWallSurfaceParameters = EnergyAnalysisForDynamo.PrepareEnergyModel.SetWallSurfaceParameters(getItemAtIndex, glazing, shading_depth, sill_height, conceptual_construction_types)
