# Dynamo graph EnergyAnalysisForDynamo_ex2a_DriveSurfacesByOrientation.dyn (Dynamo 0.7.4.3245)

# note: 1. Select Mass element from Revit/Vasari document
select_model_element = DSModelElementSelection()  # 1 picked in the model
# note: 2. Create Analysis Zones from Mass
createByMass = EnergyAnalysisForDynamo.PrepareEnergyModel.CreateByMass(select_model_element)
YAxis = Vector.YAxis()
analysisSurfaceVector = EnergyAnalysisForDynamo.PrepareEnergyModel.AnalysisSurfaceVector(createByMass.out2)
dot = Vector.Dot(YAxis, analysisSurfaceVector)
min_glazing = DoubleSlider(0.2, range=0.2..0.8)
max_glazing = DoubleSlider(0.8, range=0.2..0.8)
remapRange = Math.RemapRange(dot, min_glazing, max_glazing)
code_block = CodeBlock { 1; }
# note: 3.  Set Glazing percentage per orientation
setWallSurfaceParameters = EnergyAnalysisForDynamo.PrepareEnergyModel.SetWallSurfaceParameters(createByMass.out2, remapRange, arg3=code_block)
# note: 4. Draw Surfaces
drawAnalysisSurface = EnergyAnalysisForDynamo.PrepareEnergyModel.DrawAnalysisSurface(setWallSurfaceParameters)
